% Simulink data dictionary analogComputerData.sldd

bus_voltage_measurements = Simulink.Bus()
  V_IC: double, Unit="V"
  V_In: double, Unit="V"
  V_Out: double, Unit="V"

RTol = 1

bus_integrator_switches = Simulink.Bus()
  s_IC: double
  s_In: double

bus_integrator_measurements = Simulink.Bus()
  Mode: Enum: enum_int_mode
  V_IC: double
  V_In: double
  V_Out: double

bus_differentiator_measurements = Simulink.Bus()
  V_In: double
  V_Out: double

bus_const_multiplier_measurements = Simulink.Bus()
  V_In: double
  V_Out: double